# Dynamo graph Creating Heat-Map of the Target Estimated Locations.dyn "Creating Heat-map of the estimated locations" (Dynamo 2.1.0.7500)

select_face = DSFaceSelection()  # 1 picked in the model

# group: Points from the Excel file
file_path = Filename("forum\experiment1.xlsx")
file_from_path = FileObject(path=file_path)
string = StringInput("experiment1")
boolean = BoolSelector(false)
importExcel = Data.ImportExcel(file=file_from_path, sheetName=string, readAsStrings=boolean, showExcel=boolean)
transpose = List.Transpose(lists=importExcel)
restOfItems = List.RestOfItems(list=transpose@L2)
number = DoubleInput(0)
getItemAtIndex = List.GetItemAtIndex(list=restOfItems, index=number)
boolean_2 = BoolSelector(false)
clean = List.Clean(list=getItemAtIndex, preserveIndices=boolean_2)
number_2 = DoubleInput(1)
getItemAtIndex_2 = List.GetItemAtIndex(list=restOfItems, index=number_2)
boolean_3 = BoolSelector(false)
clean_2 = List.Clean(list=getItemAtIndex_2, preserveIndices=boolean_3)
number_3 = DoubleInput(2)
getItemAtIndex_3 = List.GetItemAtIndex(list=restOfItems, index=number_3)
boolean_4 = BoolSelector(false)
clean_3 = List.Clean(list=getItemAtIndex_3, preserveIndices=boolean_4)
byCoordinates = Point.ByCoordinates(x=clean, y=clean_2, z=clean_3)

# note: Custom Package: GeniusLoci v.2021.6.29
convert_from_projectbasepoint = Custom[Convert from ProjectBasePoint CoordinateSystem](point=byCoordinates)  # Convert from Project Base Point Coordinate to Internal Origin Coordinate.

# group: CREATE UV
byGeometry = BoundingBox.ByGeometry(geom=select_face)
toCuboid = BoundingBox.ToCuboid(boundingBox=byGeometry)
explode = Geometry.Explode(geometry=toCuboid)
code_block = CodeBlock { 0..1..#30; }

code_block_2 = CodeBlock(x=explode) { x[0]; }

# group (continued): CREATE UV
pointAtParameter = Surface.PointAtParameter(surface=code_block_2, u=code_block, v=code_block, lacing=CrossProduct)

distanceTo = Geometry.DistanceTo(geometry=convert_from_projectbasepoint, other=pointAtParameter@@L1)
minimumItem = List.MinimumItem(list=distanceTo)
code_block_3 = CodeBlock { 0; 1; }
remapRange = Math.RemapRange(numbers=minimumItem, newMin=code_block_3.out0, newMax=code_block_3.out1)

# group: CREATE GRADIENT
color_palette = ColorPalette({R: 253, G: 72, B: 72, A: 255})
color_palette_2 = ColorPalette({R: 241, G: 227, B: 81, A: 255})
color_palette_3 = ColorPalette({R: 68, G: 168, B: 220, A: 255})
color_palette_4 = ColorPalette({R: 139, G: 247, B: 162, A: 255})
list_create = List.Create(item0=color_palette, item1=color_palette_2, item2=color_palette_3, item3=color_palette_4)
count = List.Count(list=list_create)
code_block_4 = CodeBlock(c=count) { 0..1..#c; }
color_range = ColorRange(value=remapRange)  # unwired: colors, indices

bySurfaceColors = Modifiers.GeometryColor.BySurfaceColors(surface=select_face, colors=color_range)
code_block_5 = CodeBlock { 0.02; }
byCenterPointRadius = Sphere.ByCenterPointRadius(centerPoint=convert_from_projectbasepoint, radius=code_block_5)
