# Dynamo graph Retrieving information from the model.dyn (Dynamo 2.1.0.7500)

# group: Element_ID Attribute
categories = Categories("OST_Walls")
all_elements_of_category = ElementsOfCategory(Category=categories)
id = Element.Id(element=all_elements_of_category)

# group: Family Type Attribute
categories_2 = Categories("OST_Walls")
all_elements_of_category_2 = ElementsOfCategory(Category=categories_2)
name = Family.Name(family=all_elements_of_category_2)

# group: Comment Attribute
categories_3 = Categories("OST_Walls")
all_elements_of_category_3 = ElementsOfCategory(Category=categories_3)
string = StringInput("Comments")
getParameterValueByName = Element.GetParameterValueByName(element=all_elements_of_category_3, parameterName=string)

# group: Select Category
categories_4 = Categories("OST_Walls")
all_elements_of_category_4 = ElementsOfCategory(Category=categories_4)

# group: Edges of the Elements
faces = Element.Faces(element=all_elements_of_category_4)
normalAtParameter = Surface.NormalAtParameter(surface=faces)
ZAxis = Vector.ZAxis()
isParallel = Vector.IsParallel(vector=normalAtParameter, other=ZAxis)
filterByBoolMask = List.FilterByBoolMask(list=faces, mask=isParallel)
perimeterCurves = Surface.PerimeterCurves(surface=filterByBoolMask.in)
startPoint = Curve.StartPoint(curve=perimeterCurves)

# group: Geometry Attribute
join = List.Join()  # unwired: list0, list1, list2
basePoint = Coordinates.BasePoint()
X = Point.X(point=basePoint)
code_block = CodeBlock { 0; }
getItemAtIndex = List.GetItemAtIndex(list=startPoint@L3, index=code_block)
code_block_2 = CodeBlock { 0; }
getItemAtIndex_2 = List.GetItemAtIndex(list=getItemAtIndex@L2, index=code_block_2)
code_block_3 = CodeBlock { 1; }
getItemAtIndex_3 = List.GetItemAtIndex(list=getItemAtIndex@L2, index=code_block_3)
code_block_4 = CodeBlock { 2; }
getItemAtIndex_4 = List.GetItemAtIndex(list=getItemAtIndex@L2, index=code_block_4)
code_block_5 = CodeBlock { 3; }
getItemAtIndex_5 = List.GetItemAtIndex(list=getItemAtIndex@L2, index=code_block_5)
list_create = List.Create(item0=getItemAtIndex_2, item1=getItemAtIndex_3, item2=getItemAtIndex_4, item3=getItemAtIndex_5)
transpose = List.Transpose(lists=list_create)
X_2 = Point.X(point=transpose)
sub = X - X_2
code_block_6 = CodeBlock { -1; }
mul = sub * code_block_6
Y = Point.Y(point=basePoint)
Y_2 = Point.Y(point=transpose)
sub_2 = Y - Y_2
code_block_7 = CodeBlock { -1; }
mul_2 = sub_2 * code_block_7
Z = Point.Z(point=basePoint)
Z_2 = Point.Z(point=transpose)
sub_3 = Z - Z_2
code_block_8 = CodeBlock { -1; }
mul_3 = sub_3 * code_block_8
combine = List.Combine(comb=join, list1=mul, list2=mul_2, list3=mul_3)

# group: Merge Attributes
join_2 = List.Join()  # unwired: list0, list1, list2, list3
combine_2 = List.Combine(comb=join_2, list1=id, list2=name, list3=getParameterValueByName, list4=combine)

# group: Element_ID Attribute
categories_5 = Categories("OST_DetailComponents")
all_elements_of_category_5 = ElementsOfCategory(Category=categories_5)
id_2 = Element.Id(element=all_elements_of_category_5)

# group: Family Type Attribute
categories_6 = Categories("OST_DetailComponents")
all_elements_of_category_6 = ElementsOfCategory(Category=categories_6)
name_2 = Family.Name(family=all_elements_of_category_6)

# group: Comment Attribute
categories_7 = Categories("OST_DetailComponents")
all_elements_of_category_7 = ElementsOfCategory(Category=categories_7)
string_2 = StringInput("Comments")
getParameterValueByName_2 = Element.GetParameterValueByName(element=all_elements_of_category_7, parameterName=string_2)

# group: Select Category
categories_8 = Categories("OST_DetailComponents")
all_elements_of_category_8 = ElementsOfCategory(Category=categories_8)

# group: Edges of the Elements
faces_2 = Element.Faces(element=all_elements_of_category_8)
normalAtParameter_2 = Surface.NormalAtParameter(surface=faces_2)
ZAxis_2 = Vector.ZAxis()
isParallel_2 = Vector.IsParallel(vector=normalAtParameter_2, other=ZAxis_2)
filterByBoolMask_2 = List.FilterByBoolMask(list=faces_2, mask=isParallel_2)
perimeterCurves_2 = Surface.PerimeterCurves(surface=filterByBoolMask_2.in)
startPoint_2 = Curve.StartPoint(curve=perimeterCurves_2)

# group: Geometry Attribute
join_3 = List.Join()  # unwired: list0, list1, list2
basePoint_2 = Coordinates.BasePoint()
X_3 = Point.X(point=basePoint_2)
code_block_9 = CodeBlock { 0; }
getItemAtIndex_6 = List.GetItemAtIndex(list=startPoint_2@L3, index=code_block_9)
code_block_10 = CodeBlock { 0; }
getItemAtIndex_7 = List.GetItemAtIndex(list=getItemAtIndex_6@L2, index=code_block_10)
code_block_11 = CodeBlock { 1; }
getItemAtIndex_8 = List.GetItemAtIndex(list=getItemAtIndex_6@L2, index=code_block_11)
code_block_12 = CodeBlock { 2; }
getItemAtIndex_9 = List.GetItemAtIndex(list=getItemAtIndex_6@L2, index=code_block_12)
code_block_13 = CodeBlock { 3; }
getItemAtIndex_10 = List.GetItemAtIndex(list=getItemAtIndex_6@L2, index=code_block_13)
list_create_2 = List.Create(item0=getItemAtIndex_7, item1=getItemAtIndex_8, item2=getItemAtIndex_9, item3=getItemAtIndex_10)
transpose_2 = List.Transpose(lists=list_create_2)
X_4 = Point.X(point=transpose_2)
sub_4 = X_3 - X_4
code_block_14 = CodeBlock { -1; }
mul_4 = sub_4 * code_block_14
Y_3 = Point.Y(point=basePoint_2)
Y_4 = Point.Y(point=transpose_2)
sub_5 = Y_3 - Y_4
code_block_15 = CodeBlock { -1; }
mul_5 = sub_5 * code_block_15
Z_3 = Point.Z(point=basePoint_2)
Z_4 = Point.Z(point=transpose_2)
sub_6 = Z_3 - Z_4
code_block_16 = CodeBlock { -1; }
mul_6 = sub_6 * code_block_16
combine_3 = List.Combine(comb=join_3, list1=mul_4, list2=mul_5, list3=mul_6)

# group: Merge Attributes
join_4 = List.Join()  # unwired: list0, list1, list2, list3
combine_4 = List.Combine(comb=join_4, list1=id_2, list2=name_2, list3=getParameterValueByName_2, list4=combine_3)

# group: Append & Export the Data
string_3 = StringInput("C:\Users\ali\Desktop\model_zone_detection.csv")
code_block_17 = CodeBlock()
# ---------- code_block_17.designscript (3 lines) ----------
["element_id","family_type","comment",
"X1","X2","X3","X4","Y1","Y2","Y3","Y4",
"Z1","Z2","Z3","Z4"];
# ----------------------------------------
join_5 = List.Join(list0=combine_2, list1=combine_4)
addItemToFront = List.AddItemToFront(item=code_block_17, list=join_5)
exportCSV = Data.ExportCSV(filePath=string_3, data=addItemToFront)
